# Dynamo graph Generate_Floor_plans.dyn (Dynamo 2.13.1.3887)

file_path = Filename(".\Floor_plans.xlsx")
file_from_path = FileObject(path=file_path)
string = StringInput("Sheet1")
importExcel = Data.ImportExcel(file=file_from_path, sheetName=string)
code_block = CodeBlock { 1; }
getItemAtIndex = List.GetItemAtIndex(list=importExcel@L2, index=code_block)
code_block_2 = CodeBlock { 0; }
getItemAtIndex_2 = List.GetItemAtIndex(list=importExcel@L2, index=code_block_2)
byElevationAndName = Level.ByElevationAndName(elevation=getItemAtIndex, name=getItemAtIndex_2)
byLevel = FloorPlanView.ByLevel(level=byElevationAndName)
byLevel_2 = CeilingPlanView.ByLevel(level=byElevationAndName)
