# Dynamo graph Shear_walls_From_Excel_to_Revit.dyn (Dynamo 2.13.1.3887)

file_path = Filename(".\Shear_walls.xls")
file_from_path = FileObject(path=file_path)
string = StringInput("Sheet1")
importExcel = Data.ImportExcel(file=file_from_path, sheetName=string)
flatten = List.Flatten(list=importExcel)
python_script = Python(IN[0]=flatten)  # CPython3
# ---------- python_script.python (60 lines) ----------
import clr
import Revit
clr.AddReference('ProtoGeometry')
from Autodesk.DesignScript.Geometry import *

def Get_Curve(List):
    
    Curves = []
    length = len(List[0])
    
    for i in range(length):
        str = List[0][i]
        
        #---------- Get Start_X_value ----------#
        Start_X_position = str.find('X')
        Start_Xcomma_position = str.find(',', Start_X_position) # 找X后面第一个逗号的position
        Start_X_value = str[Start_X_position+4 : Start_Xcomma_position] # get x_value
        Start_X_value = float(Start_X_value) # convert into float
        
        #---------- Get Start_Y_value ----------#
        Start_Y_position = str.find('Y')
        Start_Ycomma_position = str.find(',', Start_Y_position) # 找X后面第一个逗号的position
        Start_Y_value = str[Start_Y_position+4 : Start_Ycomma_position] # get x_value
        Start_Y_value = float(Start_Y_value) # convert into float
        
        #---------- Get Start_Z_value ----------#
        Start_Z_position = str.find('Z')
        Start_Zcomma_position = str.find(')', Start_Z_position) # 找X后面第一个逗号的position
        Start_Z_value = str[Start_Z_position+4 : Start_Zcomma_position] # get x_value
        Start_Z_value = float(Start_Z_value) # convert into float
        
        #---------- Get End_X_value ----------#
        End_X_position = str.find('X', Start_Xcomma_position)
        End_Xcomma_position = str.find(',', End_X_position) # 找X后面第一个逗号的position
        End_X_value = str[End_X_position+4 : End_Xcomma_position] # get x_value
        End_X_value = float(End_X_value) # convert into float

        #---------- Get End_Y_value ----------#
        End_Y_position = str.find('Y', Start_Ycomma_position)
        End_Ycomma_position = str.find(',', End_Y_position) # 找X后面第一个逗号的position
        End_Y_value = str[End_Y_position+4 : End_Ycomma_position] # get x_value
        End_Y_value = float(End_Y_value) # convert into float
        
        #---------- Get End_Z_value ----------#
        End_Z_position = str.find('Z', Start_Zcomma_position)
        End_Zcomma_position = str.find(')', End_Z_position) # 找X后面第一个逗号的position
        End_Z_value = str[End_Z_position+4 : End_Zcomma_position] # get x_value
        End_Z_value = float(End_Z_value) # convert into float
        
        #---------- Create line object ----------#
        line = Line.ByStartPointEndPoint(Point.ByCoordinates(Start_X_value,Start_Y_value,Start_Z_value), Point.ByCoordinates(End_X_value,End_Y_value,End_Z_value))
        
        Curves.append(line)

    return Curves
    

List = IN

OUT = Get_Curve(List)
# ----------------------------------------
code_block = CodeBlock { 3000; }
levels = Levels("Level 1")
wall_types = WallTypes("Generic - 200mm - Filled")
byCurveAndHeight = Wall.ByCurveAndHeight(curve=python_script, height=code_block, level=levels, wallType=wall_types)
